# Dynamo graph SCADA_Racks_Excel.dyn (Dynamo 3.3.0.6316)
# 依機櫃規格與位置配置表產生逐台含資訊的 RFA

excel_轉換的設備_csv = StringInput("D:\SCADA_主題導覽\01_BIM model\SCADA_機櫃_Dynamo\Excel_機櫃族群\SCADA_Racks_Excel.csv")
rfa_與共用參數輸出資料夾 = StringInput("D:\SCADA_主題導覽\01_BIM model\SCADA_機櫃_Dynamo\Excel_機櫃族群\族群")
建立含資訊的電氣設備族群 = Python(IN[0]=excel_轉換的設備_csv, IN[1]=rfa_與共用參數輸出資料夾)  # CPython3
# ---------- 建立含資訊的電氣設備族群.python (264 lines) ----------
# Revit 2025 / Dynamo 3.3 / CPython3. Generated by excel_rack_families.py.
# IN[0]: equipment CSV; IN[1]: family output folder. Does not modify the active project.
import clr
import csv
import math
import os
import re
from contextlib import contextmanager
clr.AddReference("RevitAPI")
clr.AddReference("RevitServices")
from Autodesk.Revit.DB import (
    CurveArrArray, CurveArray, ExternalDefinitionCreationOptions, GroupTypeId,
    Line, Plane, SaveAsOptions, SketchPlane, SpecTypeId, Transaction, TransactionStatus, XYZ,
)
from RevitServices.Persistence import DocumentManager
from RevitServices.Transactions import TransactionManager
doc = DocumentManager.Instance.CurrentDBDocument
app = doc.Application
PARAM_GROUP = "SCADA_Excel_Racks"
PARAM_PREFIX = "SCADA_"
CODE_COLUMN = "編號"
PLACEMENT_PARAM = "SCADA_定位來源"
MM = 1.0 / 304.8


def read_rows(path):
    with open(path, encoding="utf-8-sig", newline="") as f:
        return list(csv.DictReader(f))


def num(value):
    try:
        return float(value)
    except (TypeError, ValueError):
        return 0.0


@contextmanager
def shared_parameter_definitions(names, out_dir):
    """Keep the source file and definitions alive until all family operations finish."""
    original = app.SharedParametersFilename
    sp_path = os.path.join(out_dir, "SCADA_Excel_SharedParameters.txt")
    if not os.path.exists(sp_path):
        open(sp_path, "w").close()
    try:
        app.SharedParametersFilename = sp_path
        def_file = app.OpenSharedParameterFile()
        if def_file is None:
            raise Exception("無法開啟共用參數檔 " + sp_path)
        group = def_file.Groups.get_Item(PARAM_GROUP) or def_file.Groups.Create(PARAM_GROUP)
        definitions = {}
        for name in names:
            definition = group.Definitions.get_Item(name)
            if definition is None:
                definition = group.Definitions.Create(
                    ExternalDefinitionCreationOptions(name, SpecTypeId.String.Text))
            definitions[name] = definition
        yield definitions
    finally:
        # Restore whatever was set before, including "none".
        try:
            app.SharedParametersFilename = original or ""
        except Exception:
            pass


def run_transaction(d, name, action):
    t = Transaction(d, name)
    try:
        if t.Start() != TransactionStatus.Started:
            raise Exception(name + ": 無法開始交易")
        result = action()
        status = t.Commit()
        if status != TransactionStatus.Committed:
            raise Exception(name + ": 交易未提交（" + str(status) + "）")
        return result
    except Exception:
        if t.GetStatus() == TransactionStatus.Started:
            t.RollBack()
        raise
    finally:
        t.Dispose()


def family_template_path():
    roots = [app.FamilyTemplatePath or "", r"C:\ProgramData\Autodesk\RVT 2025\Family Templates"]
    for root in roots:
        if not root:
            continue
        base = root if os.path.basename(root) == "Family Templates" else os.path.dirname(root)
        for rel in (r"Traditional Chinese\公制電氣設備.rft", r"English\Metric Electrical Equipment.rft"):
            path = os.path.join(base, rel)
            if os.path.exists(path):
                return path
    raise Exception("找不到電氣設備族群樣板（公制電氣設備.rft）")


def family_name(row):
    code = row[CODE_COLUMN]
    if not code or code != code.strip() or re.search(r'[\\/:*?"<>|]', code) or code.endswith("."):
        raise Exception("設備編號不能用作族群檔名: " + repr(code))
    location = row["安裝位置"].strip()
    station = re.fullmatch(r"Phase 1 (SB\d+) Station", location)
    if station:
        label = station.group(1)
    elif location == "Depot Administration Building - Telecom SCADA Equipment Room":
        label = "機廠行政大樓_電信SCADA設備室"
    elif location == "Depot - Administration Building - Computer Room (汐東雲平台)":
        label = "機廠行政大樓_電腦房"
    elif location == "Depot - TSS (機廠牽引變電站)":
        label = "機廠TSS"
    else:
        raise Exception("無法判定族群檔名的安裝位置: " + repr(location))
    return "SCADA_機櫃_" + code + "_" + label


def family_defaults(rows, data_columns, equipment_row=None):
    """Use exact data for equipment deliverables, or common data for reusable templates."""
    if equipment_row is not None:
        return rack_values(equipment_row, "獨立設備族群（載入專案後定位）", data_columns)
    defaults = {}
    for column in data_columns:
        values = {r[column] or "" for r in rows}
        defaults[PARAM_PREFIX + column] = (next(iter(values)) if len(values) == 1
                                           else "待填（依設備配置）")
    # Even a type currently used once must not duplicate an equipment identity.
    for column in (CODE_COLUMN, "期別", "站點", "建物", "房間", "附錄D項次", "附錄F項次"):
        if column in data_columns:
            defaults[PARAM_PREFIX + column] = "待填（依設備配置）"
    defaults[PLACEMENT_PARAM] = "手動放置（位置待確認）"
    return defaults


def add_family_parameters(manager, definitions, family_name):
    parameters = {}
    for name, definition in definitions.items():
        try:
            parameters[name] = manager.AddParameter(definition, GroupTypeId.Data, True)
        except Exception as ex:
            raise Exception("族群 " + family_name + " 加入共用參數失敗: " + name
                            + "（GUID " + str(definition.GUID) + "）: " + str(ex)) from ex
    return parameters


def build_family(name, w, dep, h, type_rows, family_dir, data_columns, definitions, equipment_row=None):
    """Create a box family (base centre at origin) with one type per rack type, saved as .rfa."""
    fdoc = app.NewFamilyDocument(family_template_path())

    def create():
        profile = CurveArray()
        p = [XYZ(-w / 2, -dep / 2, 0), XYZ(w / 2, -dep / 2, 0), XYZ(w / 2, dep / 2, 0), XYZ(-w / 2, dep / 2, 0)]
        for i in range(4):
            profile.Append(Line.CreateBound(p[i], p[(i + 1) % 4]))
        loops = CurveArrArray()
        loops.Append(profile)
        plane = SketchPlane.Create(fdoc, Plane.CreateByNormalAndOrigin(XYZ.BasisZ, XYZ.Zero))
        fdoc.FamilyCreate.NewExtrusion(True, loops, plane, h)
        manager = fdoc.FamilyManager
        parameters = add_family_parameters(manager, definitions, name)
        existing = {t.Name: t for t in manager.Types}
        for type_name, rows in sorted(type_rows.items()):
            manager.CurrentType = existing.get(type_name) or manager.NewType(type_name)
            for param_name, value in family_defaults(rows, data_columns, equipment_row).items():
                manager.Set(parameters[param_name], value)
                actual = manager.CurrentType.AsString(parameters[param_name]) or ""
                if actual != value:
                    raise Exception(name + " / " + type_name + " 族群預設資料不一致 " + param_name)
        return parameters

    try:
        parameters = run_transaction(fdoc, "SCADA rack family", create)
        if equipment_row is not None:
            for param_name, value in family_defaults([equipment_row], data_columns, equipment_row).items():
                actual = fdoc.FamilyManager.CurrentType.AsString(parameters[param_name]) or ""
                if actual != value:
                    raise Exception(name + " 族群提交後資料不一致 " + param_name)
        opts = SaveAsOptions()
        opts.OverwriteExistingFile = True
        opts.MaximumBackups = 1
        fdoc.SaveAs(os.path.join(family_dir, name + ".rfa"), opts)
        remove_backups(family_dir, name, ".rfa")
    except Exception:
        fdoc.Close(False)
        raise
    return fdoc


def build_families(rows, family_dir, data_columns, definitions):
    """Return {family name: open family document}; caller closes them."""
    equipment = {}
    names = set()
    for r in rows:
        name = family_name(r)
        if name.casefold() in names:
            raise Exception("設備族群檔名重複: " + name)
        names.add(name.casefold())
        equipment[name] = r
    families = {}
    try:
        for name, r in equipment.items():
            types = {r["機櫃類型"]: [r]}
            families[name] = build_family(name, num(r["寬mm"]) * MM, num(r["深mm"]) * MM,
                                          num(r["高mm"]) * MM, types, family_dir, data_columns, definitions,
                                          equipment_row=r)
    except Exception:
        for fdoc in families.values():
            fdoc.Close(False)
        raise
    return families


def rack_values(row, source, data_columns):
    values = {PARAM_PREFIX + c: row[c] or "" for c in data_columns}
    values[PLACEMENT_PARAM] = source
    return values


def remove_backups(rvt_dir, name, ext=".rvt"):
    # Revit keeps at least one backup (name.0001.rvt) when overwriting; drop it.
    pattern = re.compile(re.escape(name) + r"\.\d{4}" + re.escape(ext) + "$", re.IGNORECASE)
    for f in os.listdir(rvt_dir):
        if pattern.match(f):
            try:
                os.remove(os.path.join(rvt_dir, f))
            except OSError:
                pass

def main(csv_path, family_dir):
    rows = read_rows(csv_path)
    if not rows:
        raise ValueError("CSV 沒有設備資料")
    data_columns = list(rows[0])
    required = ("編號", "機櫃類型", "寬mm", "深mm", "高mm")
    if any(column not in data_columns for column in required):
        raise ValueError("CSV 缺少設備或尺寸欄位")
    for row in rows:
        if not row["機櫃類型"]:
            raise ValueError("缺少機櫃類型: " + row["編號"])
        for column in ("寬mm", "深mm", "高mm"):
            value = float(row[column])
            if not math.isfinite(value) or value <= 0:
                raise ValueError("尺寸必須為有限正數: " + row["編號"] + " / " + column)
    family_dir = os.path.abspath(family_dir)
    os.makedirs(family_dir, exist_ok=True)
    param_names = [PARAM_PREFIX + column for column in data_columns] + [PLACEMENT_PARAM]
    TransactionManager.Instance.ForceCloseTransaction()
    report = []
    with shared_parameter_definitions(param_names, family_dir) as definitions:
        families = build_families(rows, family_dir, data_columns, definitions)
        try:
            report.append("設備族群 " + str(len(families)) + " 個（每台 "
                          + str(len(definitions)) + " 欄預設資料已驗證）")
            report.extend("RFA: " + os.path.join(family_dir, name + ".rfa") for name in sorted(families))
        finally:
            for family in families.values():
                family.Close(False)
    report.append("僅輸出 RFA 完成；安裝位置為文字資料，載入專案後定位")
    return report


try:
    OUT = main(IN[0], IN[1])
except Exception as exc:
    OUT = ["執行失敗（先前成功存檔的 RFA 可能保留）: " + str(exc)]
# ----------------------------------------
執行結果 = Watch(建立含資訊的電氣設備族群)
